# Grasshopper definition 220118-gridshell-PIJP.gh (Grasshopper 1.0.7)
# plug-ins: Hops, LunchBox, Heteroptera

point = Point(Point(0.03518028254, 1.652937478, 0))
hops = Hops(
    EnterAPoint=point,
    CellRadius=Slider(20.5, range=0..100),
    NumberOfSpikes=Slider(51, range=0..100),
    Length=Slider(58.64, range=0..100),
    CacheResultsInMemory=True,
    CacheSolveResults=True,
    RemoteDefinitionLocation="C:\Users\pabli\Downloads\Spikey_setup.gh",
    RemoteSolveVersion=(0, 1, 0),
    ShowInput_Enabled=False,
    ShowInput_Path=False,
    SynchronousSolve=False)
point_2 = Point(Point(3.097887464, 2.105542616, 0))
panel = Panel(hops)
set_true_to_see_panels = GetBoolean(Toggle(False), AtLeast=1, AtMost=1, FalseValue="False", TrueValue="True")
middle_width = GetNumber(Slider(1.94, range=0..10), AtLeast=1, AtMost=1, Maximum=1.797693135e+308, Minimum=-1.797693135e+308)
set_a_point = GetPoint(point_2, AtLeast=1, AtMost=1, Realtime=True)
length = GetNumber(Slider(63.57, range=0..100), AtLeast=1, AtMost=1, Maximum=1.797693135e+308, Minimum=-1.797693135e+308)
left_width = GetNumber(Slider(4.38, range=0..10), AtLeast=1, AtMost=1, Maximum=1.797693135e+308, Minimum=-1.797693135e+308)
right_width = GetNumber(Slider(3.77, range=0..10), AtLeast=1, AtMost=1, Maximum=1.797693135e+308, Minimum=-1.797693135e+308)
construct_domain = ConstructDomain(DomainStart=Slider(0, range=0..1), DomainEnd=left_width)
unit_x = UnitX(Factor=length)
range = Range(Domain=construct_domain, Steps=Slider(2, range=0..10))
move = Move(Geometry=set_a_point, Motion=unit_x)  # -> Geometry, Transform
unit_y = UnitY(Factor=range)
construct_domain_2 = ConstructDomain(DomainStart=Slider(0, range=0..1), DomainEnd=middle_width)
line = Line(StartPoint=set_a_point, EndPoint=move.Geometry)
move_2 = Move(Geometry=line, Motion=unit_y)  # -> Geometry, Transform
range_2 = Range(Domain=construct_domain_2, Steps=Slider(2, range=0..10))
unit_y_2 = UnitY(Factor=range_2)
cull_index = CullIndex(List=move_2.Geometry, Indices="-1", Wrap=True)
list_item = ListItem(List=move_2.Geometry, Index="-1", Wrap=True)
move_3 = Move(Geometry=list_item, Motion=unit_y_2)  # -> Geometry, Transform
cull_index_2 = CullIndex(List=move_3.Geometry, Indices="0", Wrap=True)
construct_domain_3 = ConstructDomain(DomainStart=Slider(0, range=0..1), DomainEnd=right_width)
list_item_2 = ListItem(List=cull_index_2, Index="-1", Wrap=True)
range_3 = Range(Domain=construct_domain_3, Steps=Slider(2, range=0..10))
unit_y_3 = UnitY(Factor=range_3)
move_4 = Move(Geometry=list_item_2, Motion=unit_y_3)  # -> Geometry, Transform
end_points = EndPoints(Curve=line)  # -> Start, End
cull_index_3 = CullIndex(List=move_4.Geometry, Indices="0", Wrap=True)
list_item_3 = ListItem(List=move_4.Geometry, Index="-1", Wrap=True)
end_points_2 = EndPoints(Curve=list_item_3)  # -> Start, End
number_slider = Slider(3.5, range=0..10)
line_2 = Line(StartPoint=end_points.Start, EndPoint=end_points_2.Start)
line_3 = Line(StartPoint=end_points.End, EndPoint=end_points_2.End)
unit_x_2 = UnitX(Factor=expr("-X", number_slider))
unit_x_3 = UnitX(Factor=number_slider)
move_5 = Move(Geometry=line_2, Motion=unit_x_3)  # -> Geometry, Transform
move_6 = Move(Geometry=line_3, Motion=unit_x_2)  # -> Geometry, Transform
curve = Curve(cull_index)
curve_2 = Curve(move_3.Geometry)
curve_3 = Curve(cull_index_3)
explode_tree = ExplodeTree(Data=graft(curve))  # -> _0000, _0001
explode_tree_2 = ExplodeTree(Data=graft(curve_2))  # -> Branch0, Branch1, Branch2
explode_tree_3 = ExplodeTree(Data=graft(curve_3))  # -> _00000, _00001
number_slider_2 = Slider(16, range=0..20)
number_slider_3 = Slider(16, range=0..20)
curve_4 = Curve(explode_tree_2.Branch1)
curve_5 = Curve([explode_tree._0001, explode_tree_3._00000])
divide_curve = DivideCurve(Curve=curve_4, Count=number_slider_2, Kinks=False)  # -> Points, Tangents, Parameters
divide_curve_2 = DivideCurve(Curve=curve_5, Count=number_slider_3, Kinks=False)  # -> Points, Tangents, Parameters
list_item_4 = ListItem(List=flatten(curve_5), Index=0, Wrap=True)
end_points_3 = EndPoints(Curve=list_item_4)  # -> Start, End
span_02_values_to = GetNumber(Slider(-0.26, range=-10..4), AtLeast=1, AtMost=5, Maximum=1.797693135e+308, Minimum=-1.797693135e+308)
span_01_values_to = GetNumber(Slider(-8.01, range=-10..4), AtLeast=1, AtMost=5, Maximum=1.797693135e+308, Minimum=-1.797693135e+308)

construct_domain_4 = ConstructDomain(DomainStart=span_01_values_to, DomainEnd=Slider(4.5, range=-4..10))
range_4 = Range(Domain=construct_domain_4, Steps=number_slider_2)
remap_numbers = RemapNumbers(Value=curve_4, Source=range_4, Target=Domain(0, 1))  # -> Mapped, Clipped

graph_mapper = GraphMapper(range_4, x0=0, x1=3.5, y0=0, y1=3.5, container_name="Sine", Equation_px=[0, 1], Equation_py=[0.5733314753, 0])

panel_2 = Panel(graph_mapper)
unit_z = UnitZ(Factor=panel_2)
move_7 = Move(Geometry=divide_curve.Points, Motion=unit_z)  # -> Geometry, Transform

bounds = Bounds(Numbers=graph_mapper)
panel_3 = Panel(bounds)
interpolate = Interpolate(Vertices=move_7.Geometry, Degree=3, Periodic=False, KnotStyle=1)  # -> Curve, Length, Domain

construct_domain_5 = ConstructDomain(DomainStart=span_02_values_to, DomainEnd=Slider(-2.35, range=-4..10))
range_5 = Range(Domain=construct_domain_5, Steps=number_slider_3)
remap_numbers_2 = RemapNumbers(Value=curve_5, Source=range_5, Target=Domain(0, 1))  # -> Mapped, Clipped

graph_mapper_2 = GraphMapper(range_5, x0=0, x1=3.5, y0=0, y1=3.5, container_name="Sine", Equation_px=[0, 1], Equation_py=[0.3088924885, 0])
panel_4 = Panel(graph_mapper_2)

panel_5 = Panel(graph_mapper_2)
unit_z_2 = UnitZ(Factor=panel_5)
move_8 = Move(Geometry=divide_curve_2.Points, Motion=unit_z_2)  # -> Geometry, Transform

bounds_2 = Bounds(Numbers=graph_mapper_2)
deconstruct_domain = DeconstructDomain(Domain=bounds_2)  # -> Start, End
panel_6 = Panel(bounds_2)
panel_7 = Panel(deconstruct_domain.Start)
interpolate_2 = Interpolate(Vertices=move_8.Geometry, Degree=3, Periodic=False, KnotStyle=1)  # -> Curve, Length, Domain
list_item_5 = ListItem(List=flatten(interpolate_2.Curve), Index=0, Wrap=True)
end_points_4 = EndPoints(Curve=list_item_5)  # -> Start, End
distance = Distance(PointA=end_points_3.Start, PointB=end_points_4.Start)
multiplication = Multiplication(A=distance, B=Slider(1.05, range=0..10))
unit_z_3 = UnitZ(Factor=multiplication)
move_9 = Move(Geometry=[explode_tree._0000, explode_tree_3._00001], Motion=unit_z_3)  # -> Geometry, Transform
explode_tree_4 = ExplodeTree(Data=interpolate_2.Curve)  # -> _000000, _00010
explode_tree_5 = ExplodeTree(Data=move_9.Geometry)  # -> _0000, _00001
entwine = Entwine(
    Branch00=explode_tree_5._0000,
    Branch01=explode_tree_4._00010,
    Branch02=interpolate.Curve,
    Branch03=explode_tree_4._000000,
    Branch04=explode_tree_5._00001,
    FlattenInputs=True)  # -> flatten(Result)
loft = Loft(Curves=entwine, Options={Adjust=False, Closed=False, LoftEnds=0, LoftSimp=0, LoftType=0, Rebuild=10, Refit=0.01})
stream_freeze_gate = StreamFreezeGate(Data=loft, PassingSwitch=set_true_to_see_panels)
triangle_panels_b = TrianglePanelsB(Surface=stream_freeze_gate, UDivisions=Slider(10, range=0..100), VDivisions=Slider(40, range=0..100))
panel_frame = PanelFrame(Panel=triangle_panels_b, ScaleFactor=Slider(0.95, range=0..1))  # -> PanelFrame, Panel
curve_6 = Curve(triangle_panels_b)
geometry = Geometry(panel_frame.Panel)
geometry_2 = Geometry(panel_frame.PanelFrame)
context_bake = ContextBake(Geometry=loft)
context_bake_2 = ContextBake(Geometry=geometry_2)
context_bake_3 = ContextBake(Geometry=geometry)
